# Grasshopper definition speckle-grasshopper-template.gh (Grasshopper 1.0.8)
# plug-ins: Speckle.Connector.Grasshopper

# ---- group: Load Modal - Auto
speckle_model_url = SpeckleModelURL(Server="https://app.speckle.systems", User="7B5CB405D6351BBF104D692E0B6DEDFE", Workspace="e2d23276cf")
sync_load = SyncLoad(ModelLink=speckle_model_url, Run=Toggle(False))
speckle_collection = SpeckleCollection(sync_load)

# ---- group: Load Model - Manual Link
speckle_model_url_2 = SpeckleModelURL(Server="https://app.speckle.systems", User="7B5CB405D6351BBF104D692E0B6DEDFE")
load = Load(ModelLink=speckle_model_url_2)
speckle_collection_2 = SpeckleCollection(load)

# ---- group: Load Model - Manual
# Load Speckle Model
speckle_model_url_3 = SpeckleModelURL(Server="https://app.speckle.systems", User="7B5CB405D6351BBF104D692E0B6DEDFE", Workspace="e2d23276cf")
load_2 = Load(ModelLink=speckle_model_url_3)
speckle_collection_3 = SpeckleCollection(load_2)

# ---- group: Navigating Speckle Objects
speckle_collection_4 = SpeckleCollection(speckle_collection_3)
query_objects = QueryObjects(Collection=speckle_collection_4)
speckle_object = SpeckleObject(Object=query_objects)  # -> Object, Geometry, Name, Properties, Color, Material, Path
panel = Panel(speckle_object.Name)
roofs_generic_125mm = RoofsGeneric125mm(SpeckleParam=speckle_object.Object)  # -> Name, Vertices, Faces, Colors, TextureCoordinates, VertexNormals, Units, Area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
# Publish Speckle Model
panel_2 = Panel(roofs_generic_125mm.Name)

# ---- group: Navigating the Speckle Collection
# Augment Speckle Model
speckle_collection_5 = SpeckleCollection(speckle_collection_3)
gre_hou_arc = GREHOUARC(Data=speckle_collection_5)
speckle_collection_6 = SpeckleCollection()

# ---- group: Query using regex
speckle_collection_7 = SpeckleCollection(speckle_collection_3)
collection_selector = CollectionSelector(speckle_collection_7)
query_objects_2 = QueryObjects(Collection=speckle_collection_7, Path=collection_selector)

# ---- group: Filter by Property Values
speckle_collection_8 = SpeckleCollection(speckle_collection_3)
query_objects_3 = QueryObjects(Collection=speckle_collection_8)
speckle_object_2 = SpeckleObject(query_objects_3)
property_selector = PropertySelector(query_objects_3)
speckle_object_3 = SpeckleObject(speckle_object_2)
query_properties = QueryProperties(Objects=speckle_object_3, Keys=property_selector)
match_text = MatchText(Text=query_properties, Pattern="Tree", Case=True)
cull_pattern = CullPattern(List=speckle_object_3, CullPattern=match_text)
speckle_object_4 = SpeckleObject(cull_pattern)

# ---- group: Query by object props
speckle_collection_9 = SpeckleCollection(speckle_collection_3)
query_objects_4 = QueryObjects(Collection=speckle_collection_9)
filter_objects = FilterObjects(Objects=query_objects_4)  # -> Objects, CulledObjects
speckle_object_5 = SpeckleObject(filter_objects.Objects)
speckle_object_6 = SpeckleObject(filter_objects.CulledObjects)

# ---- group: Create Speckle Objects
speckle_object_7 = SpeckleObject(speckle_object_4)
create_properties = CreateProperties(TheAnswer="42", AlwaysInheritNames=False, CreateEmptyProperties=False)
speckle_object_8 = SpeckleObject(Object=speckle_object_7, Properties=create_properties, Color=ColourSwatch(SwatchColor=RGB(255, 0, 217)))  # -> Object, Geometry, Name, Properties, Color, Material, Path

# ---- group: Create Speckle Collection
create_collection = CreateCollection(Trees=speckle_object_8.Object, AlwaysInheritNames=False)

# ---- group: Publish Collection Auto
speckle_collection_10 = SpeckleCollection(create_collection)
speckle_model_url_4 = SpeckleModelURL(
    Model="846b870310",
    Project="324b339ec8",
    Server="https://app.speckle.systems",
    User="7B5CB405D6351BBF104D692E0B6DEDFE",
    Workspace="e2d23276cf")
sync_publish = SyncPublish(ModelLink=speckle_model_url_4, Collection=speckle_collection_10, Run=Toggle(False))

# ---- group: Publish Collection Manual
speckle_model_url_5 = SpeckleModelURL(
    Model="846b870310",
    Project="324b339ec8",
    Server="https://app.speckle.systems",
    User="7B5CB405D6351BBF104D692E0B6DEDFE",
    Workspace="e2d23276cf")
speckle_collection_11 = SpeckleCollection(create_collection)
publish = Publish(ModelLink=speckle_model_url_5, Collection=speckle_collection_11)
